% Simulink data dictionary test.sldd

Auth_DB_Check = 1
ID_DB_check = 0
ID_check = 0
ID_validity_check = 0
In_detection_range = 1
P1 = 1
P2 = 1
P3 = 1
P4 = 1
P5 = 1
P6 = 1
P7 = 1
P8 = 1
T_AUTH_CUAS = 1
T_AUTH_DB = 1
T_AUTH_USS = 1
T_Area = 1
T_ID_DB = 1
T_ID_Read = 1
T_ID_valid = 1
T_resp_delay = 1
T_time = 1
T_timeout = 5
T_timeout_inerdict = 5
T_verifyID = 1
Time_check = 0
Zone_check = 0
verify_ID = 0